# Dynamo graph advancedGeometryExport.dyn (Dynamo 2.6.1.8786)
# packages: MeshToolkit 3.0.0

code_block = CodeBlock { 2; }
byWidthLength = Rectangle.ByWidthLength(length=code_block)
code_block_2 = CodeBlock { 10; }
byAxis = Helix.ByAxis(pitch=code_block_2)
bySweep = Solid.BySweep(profile=byWidthLength, path=byAxis)
byGeometry = Autodesk.Dynamo.MeshToolkit.Mesh.ByGeometry(inputGeometry=bySweep)
triangles = Autodesk.Dynamo.MeshToolkit.Mesh.Triangles(mesh=byGeometry)
byJoinedSurfaces = Solid.ByJoinedSurfaces(facesOfSolid=triangles)
createIfcModel = IfcInfraToolKit_DynamoCore.IfcModelSetup.CreateIfcModel()
code_block_3 = CodeBlock { "null"; }
getGeometryInformation = IfcInfraToolKit_DynamoCore.DynamoGeometryExporter.GetGeometryInformation(solidGeometry=byJoinedSurfaces, databaseContainer=createIfcModel, productGuid=code_block_3)
directory_path = Directory("C:\Users\Sebastian Esser\Desktop")
code_block_4 = CodeBlock { "helixGeoemtry"; }
saveIfcModel = IfcInfraToolKit_DynamoCore.IfcModelSetup.SaveIfcModel(container=getGeometryInformation.DatabaseContainer, path=directory_path, modelName=code_block_4)
